# Grasshopper definition truss2d.ghx (Grasshopper 1.0.8)

number_of_trusses = Slider(5, range=1..20)
srf = Surface(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)
range = Range(Domain=Domain(0, 1), Steps=number_of_trusses)
uv_pt = ConstructPoint(XCoordinate=range, YCoordinate=range, ZCoordinate=0)
iso = IsoCurve(Surface=reparameterize(srf), UVPoint=uv_pt)  # -> UIsocurve, VIsocurve
number_of_columns = Slider(8, range=0..50)
Z = UnitZ(Factor=1)
upper_beam = Curve(iso.UIsocurve)
number_slider = Slider(0.9, range=0..0.9)
high_low_points_of_curve = Extremes(Curve=upper_beam, Plane=Z)  # -> Highest, Lowest
end = EndPoints(Curve=upper_beam)  # -> Start, End
decon_lowest_pt = Deconstruct(Point=high_low_points_of_curve.Lowest)  # -> XComponent, YComponent, ZComponent
divide_upper_beam = DivideCurve(Curve=upper_beam, Count=number_of_columns, Kinks=False)  # -> Points, Tangents, Parameters
decon_upper_points_on_beam = Deconstruct(Point=divide_upper_beam.Points)  # -> XComponent, YComponent, ZComponent
decon_end_pt = Deconstruct(Point=end.End)  # -> XComponent, YComponent, ZComponent
subtraction = Subtraction(A=decon_lowest_pt.ZComponent, B=number_slider)
decon_start_pt = Deconstruct(Point=end.Start)  # -> XComponent, YComponent, ZComponent
neg = Negative(Value=number_slider)
offset = OffsetSurface(Surface=srf, Distance=neg, Retrim=True)
iso_2 = IsoCurve(Surface=reparameterize(offset), UVPoint=uv_pt)  # -> UIsocurve, VIsocurve
lower_beam_curved = Curve(iso_2.UIsocurve)
recon_start_pt = ConstructPoint(XCoordinate=decon_start_pt.XComponent, YCoordinate=decon_start_pt.YComponent, ZCoordinate=subtraction)
recon_end_pt = ConstructPoint(XCoordinate=decon_end_pt.XComponent, YCoordinate=decon_end_pt.YComponent, ZCoordinate=subtraction)
number = Number(-1)
lower_beam_straight = Line(StartPoint=recon_start_pt, EndPoint=recon_end_pt)
straight_or_curved = Slider(0, range=0..1)
delete_last_pt = CullIndex(List=divide_upper_beam.Points, Indices=number, Wrap=True)
upper_polyline = PolyLine(Vertices=divide_upper_beam.Points, Closed=False)
filter = StreamFilter(Gate=straight_or_curved, Stream0=lower_beam_curved, Stream1=lower_beam_straight)
divide_lower_beam = DivideCurve(Curve=filter, Count=number_of_columns, Kinks=False)  # -> Points, Tangents, Parameters
decon_lower_points_on_beam = Deconstruct(Point=divide_lower_beam.Points)  # -> XComponent, YComponent, ZComponent
lower_points_for_cols = ConstructPoint(
    XCoordinate=decon_upper_points_on_beam.XComponent,
    YCoordinate=decon_upper_points_on_beam.YComponent,
    ZCoordinate=decon_lower_points_on_beam.ZComponent)
delete_last_pt_2 = CullIndex(List=lower_points_for_cols, Indices=Slider(0, range=0..1), Wrap=True)
diagonals = Line(StartPoint=delete_last_pt, EndPoint=delete_last_pt_2)
join = JoinCurves(Curves=[upper_polyline, diagonals], Preserve=False)
lower_polyline = PolyLine(Vertices=lower_points_for_cols, Closed=False)
columns = Line(StartPoint=divide_upper_beam.Points, EndPoint=lower_points_for_cols)
join_2 = JoinCurves(Curves=[lower_polyline, columns], Preserve=False)
join_3 = JoinCurves(Curves=[join, join_2], Preserve=False)
flatten = FlattenTree(Tree=join_3, Path="{0}")
pipe = Pipe(Curve=flatten, Radius=Slider(0.02, range=0..0.09), Caps=Slider(1, range=0..1))
sunion = SolidUnion(Breps=pipe)
