# Grasshopper definition reference_simple_math.ghx (Grasshopper 0.9.76)
# Generated by py2gh

a = Slider(3, range=0..10)
b = Slider(5, range=0..10)
const3 = Slider(2, range=0..10)
addition = Addition(A=a, B=b)
multiplication = Multiplication(A=addition, B=const3)
area = Panel(multiplication)
